# Grasshopper definition DF_Solkvarter_Hyllie.gh (Grasshopper 1.0.7)
# plug-ins: ClimateStudioGH, Human

pipeline = GeometryPipeline(
    GroupByLayer=False,
    GroupByType=False,
    IncludeHidden=True,
    IncludeLocked=True,
    LayerFilter="new_walls",
    NameFilter="*",
    SublayerFiltering=True,
    TypeFilter=1073741848)
pipeline_2 = GeometryPipeline(
    GroupByLayer=False,
    GroupByType=False,
    IncludeHidden=True,
    IncludeLocked=True,
    LayerFilter="new_windows",
    NameFilter="*",
    SublayerFiltering=True,
    TypeFilter=1073741848)
pipeline_3 = GeometryPipeline(
    GroupByLayer=False,
    GroupByType=False,
    IncludeHidden=True,
    IncludeLocked=True,
    LayerFilter="new_ceiling",
    NameFilter="*",
    SublayerFiltering=True,
    TypeFilter=1073741848)
pipeline_4 = GeometryPipeline(
    GroupByLayer=False,
    GroupByType=False,
    IncludeHidden=True,
    IncludeLocked=True,
    LayerFilter="new_eaves",
    NameFilter="*",
    SublayerFiltering=True,
    TypeFilter=1073741848)
pipeline_5 = GeometryPipeline(
    GroupByLayer=False,
    GroupByType=False,
    IncludeHidden=True,
    IncludeLocked=True,
    LayerFilter="new_floor",
    NameFilter="*",
    SublayerFiltering=True,
    TypeFilter=1073741848)
multiplication = Multiplication(A=Slider(5, range=0..10), B="2.79")
Z = UnitZ(Factor=multiplication)
move = Move(Geometry=pipeline_3, Motion=Z)  # -> Geometry, Transform
move_2 = Move(Geometry=pipeline_5, Motion=Z)  # -> Geometry, Transform
move_3 = Move(Geometry=pipeline_2, Motion=Z)  # -> Geometry, Transform
move_4 = Move(Geometry=pipeline_4, Motion=Z)  # -> Geometry, Transform
move_5 = Move(Geometry=pipeline, Motion=Z)  # -> Geometry, Transform
eaves = Brep(move_4.Geometry)
floor = Brep(move_2.Geometry)
windows = Brep(move_3.Geometry)
ceiling = Brep(move.Geometry)
walls = Brep(move_5.Geometry)
pipeline_6 = GeometryPipeline(
    GroupByLayer=False,
    GroupByType=False,
    IncludeHidden=True,
    IncludeLocked=True,
    LayerFilter="Mark",
    NameFilter="*",
    SublayerFiltering=True,
    TypeFilter=1073741848)
pipeline_7 = GeometryPipeline(
    GroupByLayer=False,
    GroupByType=False,
    IncludeHidden=True,
    IncludeLocked=True,
    LayerFilter="nytt",
    NameFilter="*",
    SublayerFiltering=True,
    TypeFilter=1073741848)
pipeline_8 = GeometryPipeline(
    GroupByLayer=False,
    GroupByType=False,
    IncludeHidden=True,
    IncludeLocked=True,
    LayerFilter="Balkongstaket",
    NameFilter="*",
    SublayerFiltering=True,
    TypeFilter=1073741848)
pipeline_9 = GeometryPipeline(
    GroupByLayer=False,
    GroupByType=False,
    IncludeHidden=True,
    IncludeLocked=True,
    LayerFilter="droppen_2_a",
    NameFilter="*",
    SublayerFiltering=True,
    TypeFilter=1073741848)
dpipeline = DynamicGeometryPipeline(
    LayerFilter="?????Balcony",
    TypeFilter="Brep",
    NameFilter="*",
    GroupByLayer=False,
    GroupByType=False,
    IncludeHidden=True,
    IncludeLocked=True,
    enableFullPath=False,
    listenToAttributes=True)
flip = Flip(Surface=floor)  # -> Surface, Result
join = BrepJoin(Breps=pipeline_9)  # -> Breps, Closed
material = GetCSLightingMaterial(Search="floor lm83", UnitSystem=4)
material_2 = GetCSLightingMaterial(UnitSystem=4)
material_3 = GetCSLightingMaterial(UnitSystem=4)
material_4 = GetCSLightingMaterial(UnitSystem=4)
material_5 = GetCSLightingMaterial(Search="ceiling lm83", UnitSystem=4)
material_6 = GetCSLightingMaterial(UnitSystem=4)
material_7 = GetCSLightingMaterial(UnitSystem=4)
material_8 = GetCSLightingMaterial(UnitSystem=4)
material_9 = GetCSLightingMaterial(Search="wall lm83", UnitSystem=4)
scenelayer = ConstructCSSceneLayer(
    Name="balcony_railing",
    Material=material_2,
    Geometry=pipeline_8,
    Input_0_Hidden=False,
    Input_0_Name="Name",
    Input_1_Hidden=False,
    Input_1_Name="Material",
    Input_2_Hidden=False,
    Input_2_Name="Geometry",
    Input_3_Hidden=True,
    Input_3_Name="ViewTag",
    UnitSystem=4,
    Input_3_GHParam_Branch0_Path="{0}",
    Input_3_GHParam_Branch0_Item0_null_string=False,
    Input_3_GHParam_Branch0_Item0_string="None")
scenelayer_2 = ConstructCSSceneLayer(
    Name="balcony",
    Material=material_3,
    Geometry=dpipeline,
    Input_0_Hidden=False,
    Input_0_Name="Name",
    Input_1_Hidden=False,
    Input_1_Name="Material",
    Input_2_Hidden=False,
    Input_2_Name="Geometry",
    Input_3_Hidden=True,
    Input_3_Name="ViewTag",
    UnitSystem=4,
    Input_3_GHParam_Branch0_Path="{0}",
    Input_3_GHParam_Branch0_Item0_null_string=False,
    Input_3_GHParam_Branch0_Item0_string="None")
scenelayer_3 = ConstructCSSceneLayer(
    Name="building",
    Material=material_8,
    Geometry=join.Breps,
    Input_0_Hidden=False,
    Input_0_Name="Name",
    Input_1_Hidden=False,
    Input_1_Name="Material",
    Input_2_Hidden=False,
    Input_2_Name="Geometry",
    Input_3_Hidden=True,
    Input_3_Name="ViewTag",
    UnitSystem=4,
    Input_3_GHParam_Branch0_Path="{0}",
    Input_3_GHParam_Branch0_Item0_null_string=False,
    Input_3_GHParam_Branch0_Item0_string="None")
scenelayer_4 = ConstructCSSceneLayer(
    Name="Mark",
    Material=material_4,
    Geometry=pipeline_6,
    Input_0_Hidden=False,
    Input_0_Name="Name",
    Input_1_Hidden=False,
    Input_1_Name="Material",
    Input_2_Hidden=False,
    Input_2_Name="Geometry",
    Input_3_Hidden=True,
    Input_3_Name="ViewTag",
    UnitSystem=4,
    Input_3_GHParam_Branch0_Path="{0}",
    Input_3_GHParam_Branch0_Item0_null_string=False,
    Input_3_GHParam_Branch0_Item0_string="None")
toggle = BooleanToggle(True)
scenelayer_5 = ConstructCSSceneLayer(
    Name="WALL",
    Material=material_9,
    Geometry=walls,
    Input_0_Hidden=False,
    Input_0_Name="Name",
    Input_1_Hidden=False,
    Input_1_Name="Material",
    Input_2_Hidden=False,
    Input_2_Name="Geometry",
    Input_3_Hidden=True,
    Input_3_Name="ViewTag",
    UnitSystem=4,
    Input_3_GHParam_Branch0_Path="{0}",
    Input_3_GHParam_Branch0_Item0_null_string=False,
    Input_3_GHParam_Branch0_Item0_string="None")
scenelayer_6 = ConstructCSSceneLayer(
    Name="WINDOWS",
    Material=material_7,
    Geometry=windows,
    Input_0_Hidden=False,
    Input_0_Name="Name",
    Input_1_Hidden=False,
    Input_1_Name="Material",
    Input_2_Hidden=False,
    Input_2_Name="Geometry",
    Input_3_Hidden=True,
    Input_3_Name="ViewTag",
    UnitSystem=4,
    Input_3_GHParam_Branch0_Path="{0}",
    Input_3_GHParam_Branch0_Item0_null_string=False,
    Input_3_GHParam_Branch0_Item0_string="None")
scenelayer_7 = ConstructCSSceneLayer(
    Name="CEILING",
    Material=material_5,
    Geometry=ceiling,
    Input_0_Hidden=False,
    Input_0_Name="Name",
    Input_1_Hidden=False,
    Input_1_Name="Material",
    Input_2_Hidden=False,
    Input_2_Name="Geometry",
    Input_3_Hidden=True,
    Input_3_Name="ViewTag",
    UnitSystem=4,
    Input_3_GHParam_Branch0_Path="{0}",
    Input_3_GHParam_Branch0_Item0_null_string=False,
    Input_3_GHParam_Branch0_Item0_string="None")
scenelayer_8 = ConstructCSSceneLayer(
    Name="MULLION",
    Material=material_6,
    Geometry=eaves,
    Input_0_Hidden=False,
    Input_0_Name="Name",
    Input_1_Hidden=False,
    Input_1_Name="Material",
    Input_2_Hidden=False,
    Input_2_Name="Geometry",
    Input_3_Hidden=True,
    Input_3_Name="ViewTag",
    UnitSystem=4,
    Input_3_GHParam_Branch0_Path="{0}",
    Input_3_GHParam_Branch0_Item0_null_string=False,
    Input_3_GHParam_Branch0_Item0_string="None")
scenelayer_9 = ConstructCSSceneLayer(
    Name="FLOOR",
    Material=material,
    Geometry=floor,
    Input_0_Hidden=False,
    Input_0_Name="Name",
    Input_1_Hidden=False,
    Input_1_Name="Material",
    Input_2_Hidden=False,
    Input_2_Name="Geometry",
    Input_3_Hidden=True,
    Input_3_Name="ViewTag",
    UnitSystem=4,
    Input_3_GHParam_Branch0_Path="{0}",
    Input_3_GHParam_Branch0_Item0_null_string=False,
    Input_3_GHParam_Branch0_Item0_string="None")
grid = ConstructCSSensorGrid(
    Geometry=flip.Surface,
    Spacing=Slider(0.2, range=0..1),
    WorkOffset=Slider(0.8, range=0..1),
    Input_0_Hidden=True,
    Input_0_Name="Building",
    Input_10_Hidden=True,
    Input_10_Name="SupplementalLux",
    Input_11_Hidden=True,
    Input_11_Name="TargetLux",
    Input_12_Hidden=True,
    Input_12_Name="ExcessiveLux",
    Input_13_Hidden=True,
    Input_13_Name="sDA_Time",
    Input_14_Hidden=True,
    Input_14_Name="BREEAMSpaceType",
    Input_15_Hidden=True,
    Input_15_Name="ViewOffset",
    Input_16_Hidden=True,
    Input_16_Name="ViewDirections",
    Input_17_Hidden=True,
    Input_17_Name="ViewRotation",
    Input_18_Hidden=True,
    Input_18_Name="Points Override",
    Input_19_Hidden=True,
    Input_19_Name="Normals Override",
    Input_1_Hidden=False,
    Input_1_Name="Level",
    Input_20_Hidden=True,
    Input_20_Name="Disk Radius",
    Input_21_Hidden=True,
    Input_21_Name="Normal Override",
    Input_2_Hidden=False,
    Input_2_Name="Id"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)
cull = CullPattern(List=scenelayer, CullPattern=toggle)
cull_2 = CullPattern(List=scenelayer_2, CullPattern=toggle)
data = Data(flatten([scenelayer_6, scenelayer_9, scenelayer_5, scenelayer_7, scenelayer_8, scenelayer_4, scenelayer_3, cull_2, cull]))
daylightmodel = ConstructCSDaylightModel(
    SceneLayers=data,
    SensorGrids=grid,
    NorthOffset=0,
    Input_0_Hidden=False,
    Input_0_Name="SceneLayers",
    Input_1_Hidden=False,
    Input_1_Name="Windows",
    Input_2_Hidden=False,
    Input_2_Name="Luminaires",
    Input_3_Hidden=False,
    Input_3_Name="Tubular Devices",
    Input_4_Hidden=False,
    Input_4_Name="SensorGrids",
    Input_5_Hidden=False,
    Input_5_Name="Camera",
    Input_6_Hidden=False,
    Input_6_Name="North Offset",
    UnitSystem=4)
run = Button()
daylight = RunCSDaylight(
    Name="temp",
    Model=daylightmodel,
    Samples=4096,
    Run=run,
    Input_0_Hidden=False,
    Input_0_Name="Name",
    Input_10_Hidden=False,
    Input_10_Name="Run",
    Input_1_Hidden=False,
    Input_1_Name="Model",
    Input_2_Hidden=True,
    Input_2_Name="BldgType",
    Input_3_Hidden=True,
    Input_3_Name="WeatherFile",
    Input_4_Hidden=True,
    Input_4_Name="Ground Albedo",
    Input_5_Hidden=False,
    Input_5_Name="Samples",
    Input_6_Hidden=True,
    Input_6_Name="Save Hourly",
    Input_7_Hidden=True,
    Input_7_Name="Threads",
    Input_8_Hidden=True,
    Input_8_Name="Hide Pop-up",
    Input_9_Hidden=True,
    Input_9_Name="Radiance Params",
    Standard=5,
    UnitSystem=4,
    Input_2_GHParam_Branch0_Path="{0}",
    Input_2_GHParam_Branch0_Item0_null_string=False,
    Input_2_GHParam_Branch0_Item0_string="Office",
    Input_3_GHParam_Branch0_Path="{0}",
    Input_3_GHParam_Branch0_Item0_null_string=False,
    Input_3_GHParam_Branch0_Item0_string="USA_MA_Boston-Logan.Intl.AP.725090_TMYx.2004-2018"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)
csr = LoadCSResult(
    Result=daylight,
    Header=False,
    Output_0_Hidden=False,
    Output_0_Name="Name",
    Output_10_Hidden=True,
    Output_10_Name="Weather",
    Output_11_Hidden=True,
    Output_11_Name="North",
    Output_12_Hidden=True,
    Output_12_Name="LayerNames",
    Output_13_Hidden=True,
    Output_13_Name="LayerObjects",
    Output_14_Hidden=True,
    Output_14_Name="LayerMaterials",
    Output_15_Hidden=True,
    Output_15_Name="Sky",
    Output_1_Hidden=False,
    Output_1_Name="Type",
    Output_2_Hidden=True,
    Output_2_Name="Standard",
    Output_3_Hidden=True,
    Output_3_Name="Date",
    Output_4_Hidden=True,
    Output_4_Name="Version",
    Output_5_Hidden=True,
    Output_5_Name="FileSize",
    Output_6_Hidden=True,
    Output_6_Name="RunLog",
    Output_7_Hidden=False,
    Output_7_Name="Metrics",
    Output_8_Hidden=False,
    Output_8_Name="MetricValues",
    Output_9_Hidden=False,
    Output_9_Name="Grids",
    UnitSystem=4)  # -> Name, Type, Metrics, MetricValues, Grids
extract = ExtractCSSensorGridData(
    Grid=csr.Grids,
    Metric="Daylight factor",
    Input_0_Hidden=False,
    Input_0_Name="Grid",
    Input_1_Hidden=False,
    Input_1_Name="Metric",
    UnitSystem=4)  # -> Metric, ValueS
lng = ListLength(List=csr.Metrics)
previewgrid = PreviewCSSensorGrid(
    Grid=csr.Grids,
    Metric="Daylight factor",
    Input_0_Hidden=False,
    Input_0_Name="Grid",
    Input_1_Hidden=False,
    Input_1_Name="Metric",
    Input_2_Hidden=True,
    Input_2_Name="Falsecolor",
    Input_3_Hidden=True,
    Input_3_Name="Sensor Values",
    Input_4_Hidden=True,
    Input_4_Name="Show Points",
    Input_5_Hidden=True,
    Input_5_Name="Show Edges",
    Input_6_Hidden=True,
    Input_6_Name="Show Labels",
    Input_7_Hidden=True,
    Input_7_Name="Label Format",
    Input_8_Hidden=True,
    Input_8_Name="Transform",
    Output_0_Hidden=True,
    Output_0_Name="Mesh",
    Output_1_Hidden=True,
    Output_1_Name="Texture",
    UnitSystem=4,
    Input_4_GHParam_Branch0_Path="{0}",
    Input_4_GHParam_Branch0_Item0_boolean=True,
    Input_5_GHParam_Branch0_Path="{0}",
    Input_5_GHParam_Branch0_Item0_boolean=True,
    Input_6_GHParam_Branch0_Path="{0}",
    Input_6_GHParam_Branch0_Item0_boolean=False)
degrid = DeconstructCSSensorGrid(
    Grid=csr.Grids,
    Output_0_Hidden=False,
    Output_0_Name="Building",
    Output_10_Hidden=True,
    Output_10_Name="Edges",
    Output_11_Hidden=True,
    Output_11_Name="View Points",
    Output_12_Hidden=True,
    Output_12_Name="Area",
    Output_13_Hidden=True,
    Output_13_Name="View Directions",
    Output_14_Hidden=False,
    Output_14_Name="Occupancy",
    Output_15_Hidden=True,
    Output_15_Name="View Wedges",
    Output_16_Hidden=True,
    Output_16_Name="Supplemental Lux",
    Output_17_Hidden=True,
    Output_17_Name="Target Lux",
    Output_18_Hidden=True,
    Output_18_Name="Excessive Lux",
    Output_19_Hidden=True,
    Output_19_Name="Normal Override",
    Output_1_Hidden=False,
    Output_1_Name="Level",
    Output_20_Hidden=True,
    Output_20_Name="Use Normal Override",
    Output_21_Hidden=True,
    Output_21_Name="Metrics",
    Output_22_Hidden=True,
    Output_22_Name="Values"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)  # -> Building, Level, ID, SensorPoints, WindowGroups, SensorAreas, Occupancy
area = Area(Geometry=floor)  # -> Area, Centroid
panel = Panel(extract.ValueS)
multiplication_2 = Multiplication(A=extract.ValueS, B=100)
dup = DuplicateData(Data="************************", Number=lng, Order=True)
weave = Weave(Pattern=[0, 1, 2], Stream0=dup, Stream1=csr.Metrics, Stream2=csr.MetricValues, NullGaps=False)
larger = LargerThan(FirstNumber=multiplication_2, SecondNumber=Slider(1, range=0..10))  # -> LargerThan, OrEqualTo
bnd = Bounds(Numbers=multiplication_2)
cull_3 = CullPattern(List=degrid.SensorAreas, CullPattern=larger.OrEqualTo)
panel_2 = Panel(bnd)
panel_3 = Panel(multiplication_2)
metrics = Panel(weave)
panel_4 = Panel(area.Area)
ma = MassAddition(Input=cull_3)  # -> Result, PartialResults
panel_5 = Panel(ma.Result)
division = Division(A=ma.Result, B=area.Area)
multiplication_3 = Multiplication(A=division, B=100)
procent_area_sm_upfyller_bbr_krav_df_1 = Panel(multiplication_3)
